# Grasshopper definition PolarBear_example.gh (Grasshopper 0.9.76)
# plug-ins: Python Interpreter

number_slider = Slider(0, range=0..2)  # disabled
file_path_equator = FilePath("D:\Dropbox\Maya\01.Examples\35.PolarBear\Boende-hour.epw")  # disabled
file_path_berlin = FilePath("D:\Dropbox\Maya\01.Examples\35.PolarBear\Berlin_Tempelhof-hour.epw")  # disabled
file_path_arctic = FilePath("D:\Dropbox\Maya\01.Examples\35.PolarBear\Alert-hour.epw")  # disabled
list_item = ListItem(List=[file_path_berlin, file_path_equator, file_path_arctic], Index=number_slider, Wrap=True)  # disabled
ladybug = Ladybug_Ladybug()  # -> out; plug-in component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
open_weather_file = Ladybug_OpenEPWWeatherFile(open=Toggle(True))  # -> epwFile; plug-in component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
boolean_toggle = BooleanToggle(True)  # disabled
panel = Panel("""January
February
March
April
May
June
July
August
September
October
November
December""")
importgroundtemp = Ladybug_ImportGroundTemp(epwFile=list_item, visualisedata_Season=boolean_toggle)  # -> out, groundtemp1st, groundtemp2nd, groundtemp3rd, profileCrvs, crvColors, graphAxes, graphtext, Legend; disabled; plug-in component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
number_slider_2 = Slider(6, range=1..12)
number_slider_3 = Slider(30, range=0..100)
number_slider_4 = Slider(15, range=0..15)
importepw = Ladybug_ImportEpw(epwFile=open_weather_file)  # -> Output, latitude, location, dryBulbTemperature, dewPointTemperature, relativeHumidity, windSpeed, windDirection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; plug-in component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
gencumulativeskymtx = Ladybug_GenCumulativeSkyMtx(epwFile=open_weather_file, skyDensity=0, useOldRes=True, runIt=Toggle(True))  # -> out, cumulativeSkyMtx; plug-in component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
mesh = Mesh(importgroundtemp.graphtext)  # disabled
subtraction = Subtraction(A=number_slider_2, B="1")
list_item_2 = ListItem(List=panel, Index=subtraction, Wrap=True)
analysisperiod = Ladybug_AnalysisPeriod(
    fromMonth=number_slider_2,
    fromDay=number_slider_4,
    fromHour=Slider(0, range=0..24),
    toMonth=number_slider_2,
    toDay=number_slider_4,
    toHour=Slider(24, range=0..24))  # -> out, analysisPeriod; plug-in component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
panel_2 = Panel(list_item_2)
point = Point(<point referenced from the Rhino model>)
sunpath = Ladybug_SunPath(
    location=importepw.location,
    hour=12,
    day=21,
    month=12,
    timeStep=1,
    analysisPeriod=analysisperiod.analysisPeriod,
    centerPt=point,
    sunPathScale=Slider(0.04, range=0..0.1),
    annualHourlyData=flatten(importepw.globalHorizontalRadiation),
    dailyOrAnnualSunPath=True)  # -> out, sunVectors, sunAltitudes, sunAzimuths, port, sunSpheresMesh, sunPathCrvs, legend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; plug-in component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
timer = Timer(TimerInterval=50, Target=orient2camera)
selectskymtx = Ladybug_selectSkyMtx(
    cumulativeSkyMtx=gencumulativeskymtx.cumulativeSkyMtx,
    analysisPeriod=analysisperiod.analysisPeriod,
    removeDiffuse=False,
    removeDirect=False)  # -> out, selectedSkyMtx; plug-in component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
point_2 = Point(<point referenced from the Rhino model>)
orient2camera = Ladybug_OrientToCamera(initPosition=point_2)  # -> orientedToCam; plug-in component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
colour_swatch = ColourSwatch(SwatchColor=RGB(255, 250, 250))
geometry = Geometry(sunpath.sunSpheresMesh)
geometry_2 = Geometry(sunpath.sunPathCrvs)
text_tag_3d = TextTag3D(
    Location=orient2camera,
    Text=panel_2,
    Size=Slider(490, range=0..1000),
    Colour=ColourSwatch(SwatchColor=RGB(10, 10, 9)),
    Justification=7)
custom_preview = CustomPreview(Geometry=geometry_2, Shader=ColourSwatch(SwatchColor=RGB(0, 0, 0)))
geometry_3 = Geometry(<mesh referenced from the Rhino model>)
radiationanalysis = Ladybug_RadiationAnalysis(
    north=0,
    geometry=flatten(geometry_3),
    gridSize=Slider(700, range=0..1000),
    disFromBase=Slider(100, range=0..100),
    selectedSkyMtx=flatten(selectskymtx.selectedSkyMtx),
    runIt=Toggle(True))  # -> out, contextMesh, analysisMesh, testPts, testVec, port, radiationResult, radiationMesh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; plug-in component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
geometry_4 = Geometry(radiationanalysis.radiationLegend)
mesh_2 = Mesh(radiationanalysis.radiationMesh)
